vi "Main.gviweb"   [LabVIEW NXG 3.0.0]
panel controls:
  "Tab": i32
  "Button": bool
  "Height Offset of Box": f64 = 0.5
panel indicators:
  "URL Image": string
  "Output": error
uses:
  WebApp::AugmentedReality.jsli::Replace Control with AR
  WebApp::AugmentedReality.jsli::Set Model Height
diagram:
  while {
    Wait(time to wait=10)
    stop if $Button
  }
  call "Replace Control with AR"(text control selector="ni-text[ni-control-id='59']", error in=no error) -> (error out=w1)
  s1 = w1  # shift register
  while {
    call "Set Model Height"(new height=$"Height Offset of Box", error in=s1) -> (error out=w2)
    Wait(time to wait=10)
    next s1 = w2
    stop if w2
  }
  $Output <- s1
